# Grasshopper definition 180516_EnergyAI_DeployModel.gh (Grasshopper 0.9.76)
# plug-ins: GH_CPython

# ----
# Variable Parameters: ASHRAE Climate Zone
# Orientation
# WWR
# U Value
# SHGC
# Overhang Depth
# HVAC System Type
# Heat Recovery
heat_recovery = Slider(0, range=0..2)
ashrae_climate_zone = Slider(3, range=1..8)
orientation = Slider(0, range=0..4)
u_value = Slider(0, range=0..1)
shgc = Slider(2, range=0..2)
overhang = Slider(0, range=0..2)
hvac_system_type = Slider(0, range=0..2)
wwr = Slider(0, range=0..6)

overhang_depth = Panel("""0
0.5
1""")
item = ListItem(List=overhang_depth, Index=overhang, Wrap=True)

wwr_2 = Panel("""0.2
0.3
0.4
0.5
0.6
0.7
0.8""")
item_2 = ListItem(List=wwr_2, Index=wwr, Wrap=True)
multiplication = Multiplication(A=item_2, B=Slider(10, range=0..10))

shgc_2 = Panel("""0.2
0.3
0.4""")
item_3 = ListItem(List=shgc_2, Index=shgc, Wrap=True)

data = Data([ashrae_climate_zone, orientation, multiplication, u_value, item_3, item, hvac_system_type, heat_recovery])

panel = Panel("D:\Projects\Research\MachineLearning\MLDS\EnergyAI\ML_Files\SavedModels\StratifyByCZ\GBM_bin.pkl")
panel_2 = Panel("D:\Projects\Research\SimAud_ParametricAI\MLPart\Encoded_inputs.csv")
gh_cpython = GH_CPython(savedModel=panel, inputs=panel_2, parameters=data)  # -> output; inputs savedModel: list, inputs: list, parameters: list
#   port savedModel: [required] - [type = int] - [default = None] Descripe your input here * bullet point. * bullet point
#   port output: indicate your output description here. refers to a new line.
# ---------- gh_cpython: Python ----------
import category_encoders as ce
import numpy as np
from sklearn.externals import joblib
import pandas as pd
Inputs = np.loadtxt(_inputs) 
binary = ce.BinaryEncoder(verbose=1, drop_invariant=True, cols=[0,1,3,6,7]).fit(Inputs)


model = joblib.load(_savedModel)
parameters = np.array(parameters).reshape(1,8)
enc_inputs = binary.transform(parameters)
output_ = model.predict(enc_inputs)
output_ = output_[0]
print(parameters)
print(enc_inputs)
print(output_)
# ---------- end gh_cpython ----------
energy_use_intensity_kwh_year = Panel(gh_cpython)

panel_3 = Panel("D:\Projects\Research\MachineLearning\MLDS\EnergyAI\ML_Files\SavedModels\GBMGrid.pkl")
panel_4 = Panel("D:\Projects\Research\SimAud_ParametricAI\MLPart\Encoded_inputs.csv")
gh_cpython_2 = GH_CPython(savedModel=panel_3, inputs=panel_4, parameters=data)  # -> output; inputs savedModel: list, inputs: list, parameters: list; same code as gh_cpython
energy_use_intensity_kwh_year_2 = Panel(gh_cpython_2)
