# Grasshopper definition 180516_EnergyAI_ReadResultsFromIDFs.gh (Grasshopper 0.9.76)
# plug-ins: Heteroptera, Python Interpreter

ladybug = Ladybug_Ladybug()  # -> Vviiiiiiiiiizzz; plug-in component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
honeybee = Honeybee_Honeybee()  # -> Vviiiiiiiiiizzz; plug-in component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
lookupfolder_energyplus = Honeybee_LookupEnergyPlusFolder(studyFolder="D:\Projects\Research\SimAud_ParametricAI\IDFs\Done\CZ8", studyType=Slider(2, range=0..10))  # -> readMe, idfFiles, osmFiles, resultFileAddress, scheduleCsvFiles, rddFiles, errFiles, eioFiles, esoFiles, sqlFiles; plug-in component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
number_slider = Slider(0, range=0..5666)
fly = Ladybug_fly(inputSliders=number_slider, fly=Toggle(False))  # -> Vviiiiiiiiiizzz; plug-in component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
item = ListItem(List=lookupfolder_energyplus.resultFileAddress, Index=number_slider, Wrap=True)
item_2 = ListItem(List=lookupfolder_energyplus.osmFiles, Index=number_slider, Wrap=True)
panel = Panel(item_2)
panel_2 = Panel("""_
\
""")
split = TextSplit(Text=item_2, Separators=panel_2)
readepresult = Honeybee_ReadEPResult(resultFileAddress=item)  # -> totalThermalLoad, thermalLoadBalance, cooling, heating, electricLight, electricEquip, fanElectric, pumpElectric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; plug-in component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
item_3 = ListItem(List=lookupfolder_energyplus.eioFiles, Index=number_slider, Wrap=True)
bang = ExplodeTree(Data=graft(split))  # -> _0000, Branch1, Branch2, Branch3, Branch4, Branch5, Branch6, Branch7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
readeio = Honeybee_ReadHVACSizing(eioFile=item_3)  # -> zonePeakLoadObjs, zonePeakLoadVals, zoneSizingObjs, zoneSizingValues, systemSizingObjs, systemSizingVals, componentSizObjs, componentSizVals; plug-in component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
panel_3 = Panel(bang.Branch12)
panel_4 = Panel(bang.Branch13)
panel_5 = Panel(bang.Branch11)
panel_6 = Panel(bang.Branch14)
panel_7 = Panel(bang.Branch15)
panel_8 = Panel(bang.Branch23)
panel_9 = Panel(bang.Branch10)
panel_10 = Panel(bang.Branch17)
panel_11 = Panel(bang.Branch22)
panel_12 = Panel(bang.Branch9)
panel_13 = Panel(bang.Branch18)
panel_14 = Panel(bang.Branch19)
panel_15 = Panel(bang.Branch21)
panel_16 = Panel(bang.Branch8)
panel_17 = Panel(bang.Branch16)
panel_18 = Panel(bang.Branch20)
bang_2 = ExplodeTree(Data=graft(readeio.zoneSizingValues))  # -> Branch0, Branch1
bang_3 = ExplodeTree(Data=graft(readeio.zonePeakLoadVals))  # -> Branch0, Branch1
strnum = Ladybug_SeparateData(inputList=flatten(readepresult.operativeTemperature))  # -> numbers, strings; plug-in component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
strnum_2 = Ladybug_SeparateData(inputList=flatten(readepresult.cooling))  # -> numbers, strings; plug-in component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
strnum_3 = Ladybug_SeparateData(inputList=flatten(readepresult.heating))  # -> numbers, strings; plug-in component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
strnum_4 = Ladybug_SeparateData(inputList=flatten(readepresult.electricLight))  # -> numbers, strings; plug-in component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
strnum_5 = Ladybug_SeparateData(inputList=flatten(readepresult.fanElectric))  # -> numbers, strings; plug-in component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
strnum_6 = Ladybug_SeparateData(inputList=flatten(readepresult.pumpElectric))  # -> numbers, strings; plug-in component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
strnum_7 = Ladybug_SeparateData(inputList=flatten(readepresult.airTemperature))  # -> numbers, strings; plug-in component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
strnum_8 = Ladybug_SeparateData(inputList=flatten(readepresult.meanRadTemperature))  # -> numbers, strings; plug-in component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
strnum_9 = Ladybug_SeparateData(inputList=flatten(readepresult.relativeHumidity))  # -> numbers, strings; plug-in component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
bang_4 = ExplodeTree(Data=strnum_2.numbers)  # -> Branch0, Branch1
bang_5 = ExplodeTree(Data=strnum_3.numbers)  # -> Branch0, Branch1, Branch2, Branch3
bang_6 = ExplodeTree(Data=strnum_5.numbers)  # -> Branch0, Branch1
bang_7 = ExplodeTree(Data=strnum_6.numbers)  # -> Branch0, Branch1, Branch2
extremums = MinMax(Number=strnum.numbers)  # -> Minimum, Maximum
extremums_2 = MinMax(Number=strnum_8.numbers)  # -> Minimum, Maximum
extremums_3 = MinMax(Number=strnum_9.numbers)  # -> Minimum, Maximum
extremums_4 = MinMax(Number=strnum_7.numbers)  # -> Minimum, Maximum
avr = Average(Input=strnum.numbers)
avr_2 = Average(Input=strnum_8.numbers)
avr_3 = Average(Input=strnum_9.numbers)
avr_4 = Average(Input=strnum_7.numbers)
addition = Addition(A=bang_6.Branch0, B=bang_6.Branch1)
addition_2 = Addition(A=bang_5.Branch0, B=bang_5.Branch1, C=bang_5.Branch2, D=bang_5.Branch3)
addition_3 = Addition(A=bang_7.Branch0, B=bang_7.Branch1, C=bang_7.Branch2)
split_2 = SplitList(List=bang_4.Branch1, Index=Slider(8760, range=0..10000))  # -> ListA, ListB
addition_4 = Addition(A=bang_4.Branch0, B=split_2.ListA, C=split_2.ListB)
ma = MassAddition(Input=addition_2)  # -> Result, PartialResults
ma_2 = MassAddition(Input=addition_4)  # -> Result, PartialResults
ma_3 = MassAddition(Input=strnum_4.numbers)  # -> Result, PartialResults
ma_4 = MassAddition(Input=addition_3)  # -> Result, PartialResults
ma_5 = MassAddition(Input=addition)  # -> Result, PartialResults
entwine = Entwine(
    Branch00=panel_12,
    Branch01=panel_5,
    Branch02=panel_4,
    Branch03=panel_7,
    Branch04=panel_10,
    Branch05=panel_14,
    Branch06=panel_15,
    Branch07=panel_8,
    Branch08=ma_2.Result,
    Branch09=ma.Result,
    Branch010=ma_3.Result,
    Branch011=ma_5.Result,
    Branch012=ma_4.Result,
    Branch013=avr,
    Branch014=extremums.Minimum,
    Branch015=extremums.Maximum,
    Branch016=avr_4,
    Branch017=extremums_4.Minimum,
    Branch018=extremums_4.Maximum,
    Branch019=avr_2,
    Branch020=extremums_2.Minimum,
    Branch021=extremums_2.Maximum,
    Branch022=avr_3,
    Branch023=extremums_3.Minimum,
    Branch024=extremums_3.Maximum,
    Branch025=bang_3.Branch0,
    Branch026=bang_3.Branch1,
    Branch027=bang_2.Branch0,
    Branch028=bang_2.Branch1,
    FlattenInputs=True)
panel_19 = Panel("""CZ
OR
WWR
UV
SHGC
OV
HVAC
HR
TC
TH
TL
TE
TF
TP
OT_AV
OT_MIN
OT_MAX
AT_AV
AT_MIN
AT_MAX
MRT_AV
MRT_MIN
MRT_MAX
RH_AV
RH_MIN
RH_MAX
CL
HL
CS
HS""")
panel_20 = Panel("D:\Projects\Research\SimAud_ParametricAI\Results\ClimateZone_8.xlsx")
xl_data_record = XLDataRecordStream(XL_Path=panel_20, Data=flatten(entwine), ByColumn=Toggle(False), Stream=Toggle(False))  # -> out, A, B; inputs XL_Path: list, Origin: Point3d, Data: list, XL_Fill: list, XL_Line: list, XL_Font: list
# ---------- xl_data_record: VB ----------
    Component.Params.Input(0).Name = "Path"
    Component.Params.Input(0).Description = "Optional input for the XL Path component which specifies the target Workbook and Sheet. If blank the active workbook and worksheet is used, or the worksheet index supplied by an origin component"
    Component.Params.Input(1).Name = "Data Origin"
    Component.Params.Input(1).Description = "Optional point list input which specifies the lower bounds to which data will be written where X = Row, Y = Column, and Z = Sheet Index. If Z = 0 the active sheet will be used. If input is empty cell A1 will be used"
    Component.Params.Input(2).Name = "Data"
    Component.Params.Input(2).Description = "Input for generic data which will be converted into number or text. The first branch of the tree specifies the column location relative to the origin and the list the row location. The second branch specifies the provided sheet index if more than one sheet has been specified from the origin"
    Component.Params.Input(3).Name = "By Column"
    Component.Params.Input(3).Description = "Sets if data will be transposed"
    Component.Params.Input(4).Name = "XL Fill"
    Component.Params.Input(4).Description = "Input for the XL Fill component which will specify the cell's background fill formatting"
    Component.Params.Input(5).Name = "XL Line"
    Component.Params.Input(5).Description = "Input for the XL Line component which will specify the cell's border formatting"
    Component.Params.Input(6).Name = "XL Font"
    Component.Params.Input(6).Description = "Input for the XL Font component which will specify the cell's font formatting"
    Component.Params.Input(7).Name = "Stream"
    Component.Params.Input(7).Description = "If true, data will be written"

    Component.Params.Output(1).Name = "Origin"
    Component.Params.Output(1).Description = "List output of points which specify the lower bounds of written data"
    Component.Params.Output(2).Name = "Bound"
    Component.Params.Output(2).Description = "List output of points which specify the upper bounds of written data"

    If _Stream = True Then

      If data.Count() > 0 Then

        Dim objExcel, excelWorkbook, excelSheet As Object

        If XL_Path.Count() > 1 Then
          objExcel = XL_Path.item(0)
          excelWorkbook = XL_Path.item(1)
          excelSheet = XL_Path.item(2)
        Else
          Dim oldCI As System.Globalization.CultureInfo = system.Threading.Thread.CurrentThread.CurrentCulture
          System.Threading.Thread.CurrentThread.CurrentCulture = New System.Globalization.CultureInfo("en-US")

          'Access Active Session of Excel if no Path is specified
          objExcel = System.Runtime.InteropServices.Marshal.GetActiveObject("Excel.Application")
          excelWorkbook = objExcel.activeWorkbook
          excelSheet = objExcel.ActiveSheet
        End If
        objExcel.screenUpdating = False
        '#############################################

        ' Begin Formatting and Populating Data
        Dim i,t As Integer
        Dim Xmax,Ymax As Integer
        Dim cnt As New list(Of Integer)
        Dim blnP, blnL, blnF As Boolean
        Dim ptA, ptB As New list(Of point3d)
        Dim org,bnd As point3d

        Ymax = excelSheet.usedrange.columns(excelSheet.usedrange.columns.count).column
        Xmax = excelSheet.usedrange.rows(excelSheet.usedrange.rows.count).row


        ' if there is no origin specified use first open cell
        If Origin = Nothing Then
          If byColumn Then
            Origin.X = Ymax + 1
            Origin.Y = 1
          Else
            Origin.X = 1
            Origin.Y = Xmax + 1
          End If
        Else
          If ymax < origin.x Then ymax = origin.x - 1
          If xmax < origin.y Then xmax = origin.y - 1
        End If

        If objExcel.WorksheetFunction.CountA(excelSheet.range(excelSheet.cells(xmax, ymax), excelSheet.cells(xmax, ymax))) = 0 Then
          If origin.y = yMax Then yMax = yMax - 1
          If origin.x = xMax Then xmax = xmax - 1
        End If

        Dim rng As Object
        If byColumn Then
          org.X = ymax + 1
          org.y = origin.y
          bnd.x = ymax + 1
          bnd.y = origin.y + Data.count() - 1
        Else
          org.X = origin.x
          org.y = xmax + 1
          bnd.x = origin.x + Data.count() - 1
          bnd.y = xmax + 1
        End If

        'specify a range in excel and stream data
        rng = excelSheet.Range(excelSheet.Cells(org.Y, org.X), excelSheet.Cells(bnd.Y, bnd.X))

        If byColumn Then
          rng.value = objExcel.transpose(TreeToArr(Data))
        Else
          rng.value = TreeToArr(Data)
        End If

        ' Begin Formatting

        'Set the fill formatting
        If XL_Fill.count() > 0 Then
          blnP = True
          If XL_Fill.count() = 1  Then
            Call FillFormat(rng, XL_Fill.item(0))
            blnP = False
          End If
        End If

        'Set the fill formatting
        If XL_Line.count() > 0 Then
          blnL = True
          If (XL_Line.count() = 1) And (CBool(Split(XL_Line.item(0), "~")(5).trim()) = False) Then
            Call LineFormat(rng, XL_Line.item(0))
            blnL = False
          End If
        End If

        'Set the font formatting
        If XL_Font.count() > 0 Then
          blnF = True
          If XL_Font.count() = 1 Then
            Call FontFormat(rng, XL_Font.item(0))
            blnF = False
          End If
        End If

        For i = 0 To Data.count() - 1 Step 1

          If blnP Then
            If i > XL_Fill.count() - 1 Then t = XL_Fill.count - 1 Else t = i
            If byColumn Then
              Call FillFormat(excelSheet.Cells(org.Y + i, org.X), CStr(XL_Fill.item(t)))
            Else
              Call FillFormat(excelSheet.Cells(org.Y, org.X + i), CStr(XL_Fill.item(t)))
            End If
          End If

          If blnL Then
            If i > XL_Line.count() - 1 Then t = XL_Line.count - 1 Else t = i
            If byColumn Then
              Call LineFormat(excelSheet.Cells(org.Y + i, org.X), CStr(XL_Line.item(t)))
            Else
              Call LineFormat(excelSheet.Cells(org.Y, org.X + i), CStr(XL_Line.item(t)))
            End If
          End If

          If blnF Then
            If i > XL_Font.count() - 1 Then t = XL_Font.count - 1 Else t = i
            If byColumn Then
              Call FontFormat(excelSheet.Cells(org.Y + i, org.X), CStr(XL_Font.item(t)))
            Else
              Call FontFormat(excelSheet.Cells(org.Y, org.X + i), CStr(XL_Font.item(t)))
            End If
          End If
        Next

        objExcel.screenUpdating = True

        A = New point3d(excelSheet.usedrange.column, excelSheet.usedrange.row, excelSheet.Index)
        B = New point3d(excelSheet.usedrange.columns(excelSheet.usedrange.columns.count).column, excelSheet.usedrange.rows(excelSheet.usedrange.rows.count).row, excelSheet.Index)
      End If
    End If
# ---------- xl_data_record: VB additional code ----------
  'Cell Fill format
  Private Function FillFormat(ByVal obj As Object, ByVal strOptions As String)
    Dim arrOpt() As String = Split(strOptions, "~")
    Dim clrB() As String = Split(arrOpt(2), ",")
    Dim clrF() As String = Split(arrOpt(1), ",")
    With obj
      .Interior.Pattern = CInt(arrOpt(0))
      .Interior.Patterncolor = RGB(CInt(clrF(0).trim()), CInt(clrF(1).trim()), CInt(clrF(2).trim()))
      .Interior.color = RGB(CInt(clrB(0).trim()), CInt(clrB(1).trim()), CInt(clrB(2).trim()))

    End With
    Return Nothing
  End Function

  'Cell Line format
  Private Function LineFormat(ByVal obj As Object, ByVal strOptions As String)
    Dim arrOpt() As String = Split(strOptions, "~")
    Dim clrF() As String = Split(arrOpt(2), ",")
    With obj
      .BorderAround(CInt(arrOpt(0)), CInt(arrOpt(1)),, RGB(CInt(clrF(0).trim()), CInt(clrF(1).trim()), CInt(clrF(2).trim())))
    End With
    Return Nothing
  End Function

  'Sets font properties
  Private Function FontFormat(ByVal obj As Object, ByVal strOptions As String)
    Dim arrOpt() As String = Split(strOptions, "~")
    Dim clrF() As String = Split(arrOpt(1), ",")
    With obj
      .Font.Name = CStr(arrOpt(8).trim())
      .Font.Size = CInt(arrOpt(0).trim())
      .Font.Color = RGB(CInt(clrF(0).trim()), CInt(clrF(1).trim()), CInt(clrF(2).trim()))
      .HorizontalAlignment = CInt(arrOpt(2).trim())
      .VerticalAlignment = CInt(arrOpt(3).trim())
      .Font.Bold = CBool(arrOpt(4).trim())
      .Font.Italic = CBool(arrOpt(5).trim())
      .Font.Underline = CBool(arrOpt(6).trim())
      .Font.Strikethrough = CBool(arrOpt(7).trim())
    End With
    Return Nothing
  End Function

  Private Function TreeToArr(ByVal arrList As List(Of Object))

    Dim i,x,y As Integer

    x = 0
    y = arrList.count() - 1

    Dim arrOut(x,y) As Object

    For i = 0 To y Step 1
      arrOut(0, i) = arrList.item(i)
    Next

    Return arrOut
  End Function
  Function remapTree(ByVal arrTree As datatree(Of Object))
    If arrTree.branchcount() > 0 Then
      Dim i,j,k,m,r,s As Integer
      Dim uTree,tTree As New datatree(Of Object)
      Dim sTree As New list(Of datatree(Of Object))

      If uBound(arrTree.Paths.item(0).indices()) > 1 Then
        For i = 0 To arrTree.branchcount() - 1 Step 1
          Dim tPath As gh_path
          Dim tint() As int32
          tPath = arrTree.Paths.item(i)
          tint = tPath.Indices

          If uBound(tint) > 0 Then
            For j = 0 To arrTree.Branch(i).Count() - 1 Step 1
              uTree.add(arrTree.Branch(i).item(j), New gh_path({tint(uBound(tint) - 1),tint(uBound(tint))}))
            Next
          Else
            For j = 0 To arrTree.Branch(i).Count() - 1 Step 1
              uTree.add(arrTree.Branch(i).item(j), New gh_path({0,i}))
            Next
          End If
        Next
      Else
        uTree = arrTree
      End If

      If uBound(uTree.Paths.item(0).indices()) > 0 Then
        k = uTree.Paths.item(0).indices(uBound(uTree.Paths.item(0).indices()) - 1)
        For i = 0 To uTree.branchcount() - 1 Step 1
          Dim tPath As gh_path
          Dim tint() As int32
          tPath = uTree.Paths.item(i)
          tint = tPath.Indices

          If tint(uBound(tint) - 1) > k Then
            Dim tmpTree As New datatree(Of Object)
            For r = 0 To tTree.branchcount() - 1 Step 1
              For s = 0 To tTree.branch(r).count() - 1 Step 1
                tmpTree.add(tTree.branch(r).item(s), New gh_path(r))
              Next
            Next
            sTree.add(tmpTree)
            tTree.clear
            k = tint(uBound(tint) - 1)
            m = 0
          End If
          For j = 0 To uTree.Branch(i).Count() - 1 Step 1
            tTree.add(uTree.Branch(i).item(j), New gh_path(m))
          Next
          m += 1
        Next

        sTree.add(tTree)
      Else
        sTree.add(uTree)
      End If
      Return sTree
    Else
      Return Nothing
    End If
  End Function
  Function flipMatrix(ByVal arrVal As datatree(Of Object))
    Dim objOut As New DataTree(Of Object)
    Dim source As New GH_Lexer("{A}(B)")
    Dim target As New GH_Lexer("{B}(A)")

    GH_Lexer.PerformLexicalReplace(source, target, arrVal, objOut)

    Return objOut
  End Function
  Function lexGraft(ByVal arrVal As datatree(Of Object))
    Dim objOut As New DataTree(Of Object)
    Dim source As New GH_Lexer("{A}(i)")
    Dim target As New GH_Lexer("{A;0}(i)")

    GH_Lexer.PerformLexicalReplace(source, target, arrVal, objOut)

    Return objOut
  End Function
# ---------- end xl_data_record ----------
