# Grasshopper definition 180516_EnergyAI_RunOSMsOnly_Parallel.gh (Grasshopper 0.9.76)
# plug-ins: Python Interpreter

ladybug = Ladybug_Ladybug()  # -> Vviiiiiiiiiizzz; plug-in component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

lookupfolder_energyplus = Honeybee_LookupEnergyPlusFolder(studyFolder="D:\Projects\Research\SimAud_ParametricAI\IDFs", studyType=Slider(2, range=0..10))  # -> readMe, idfFiles, osmFiles, resultFileAddress, scheduleCsvFiles, rddFiles, errFiles, eioFiles, esoFiles, sqlFiles; plug-in component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
number_slider = Slider(0, range=0..10000)
partition = PartitionList(List=lookupfolder_energyplus.osmFiles, Size=Slider(8, range=0..10))
branch = TreeBranch(Tree=simplify(partition), Path=number_slider, MaintainPaths=True)

honeybee = Honeybee_Honeybee()  # -> Vviiiiiiiiiizzz; plug-in component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

item = ListItem(List=branch, Index=number_slider, Wrap=True)
split = TextSplit(Text=item, Separators="\")
item_2 = ListItem(List=split, Index=Slider(7, range=0..10), Wrap=True)
split_2 = TextSplit(Text=item_2, Separators="_")
cull = CullPattern(List=split_2, CullPattern=invert([True, False]))
cull_2 = CullPattern(List=split_2, CullPattern=[True, False])
panel = Panel(cull_2)
panel_2 = Panel(cull)

item_3 = ListItem(List=cull, Index=0, Wrap=True)

# ---- group: Importing Weather Data for all Climate Zones
# Selected Locations: Kuala Lumpur - Malaysia
# Brisbane - Australia
# Athens - Greece
# Boston - USA
# Amsterdam - Netherlands
# Helsinki - Finland
# Irkutsk - Russia
# Yellowknife - Canada
# ASHRAE Climate Zone Description: Very Hot - Humid
# Hot - Humid
# Warm - Humid
# Cold - Humid
# Mixed - Humid
# Cold - Humid
# Very Cold
# Subarctic
# Koppen Climate Zone Description: Tropical Rainforest Climate
# This type of climate has every month of the year with an average temperature of 18 °C (64.4 °F) or higher, with precipitation all year long. Monthly temperature variations in this climate are less than 3 degrees Celsius. Because of intense surface heating and high humidity cumulus and cumulonimbus clouds form early in the afternoons almost every day. Daily highs are about 32 degrees Celsius while night time temperatures average 22 degrees Celsius.
# Examples;
# Singapore
# West Palm Beach, Florida, USA
# Hilo, Hawai, USA
# Moist mid-latitude climate with mild winters.
# This is a temperate climate without dry season and a hot summer.
# Examples;
# Sao Paulo, Brazil
# Brisbane, Australia
# Sydney, Australia
# Orlando, Florida, USA
# New Orleans, Florida, USA
# Washington D.C. USA
# Dallas, Texas, USA
# Srinagar, India
# Shanghai, China
# Nanjing, China
# Tokyo, Japan
# Osaka, Japan
# Milan, Italy
# Durban, South Africa
# Moist mid-latitude climate with mild winters.
# This is a temperate climate without dry season and a hot summer.
# Examples;
# Sao Paulo, Brazil
# Brisbane, Australia
# Sydney, Australia
# Orlando, Florida, USA
# New Orleans, Florida, USA
# Washington D.C. USA
# Dallas, Texas, USA
# Srinagar, India
# Shanghai, China
# Nanjing, China
# Tokyo, Japan
# Osaka, Japan
# Milan, Italy
# Durban, South Africa
# Moist mid-latitude climate with cold winters.
# This is a cold climate without dry season and hot summer.
# Examples;
# Chicago, Illinois, USA
# Columbus, Ohio, USA
# Boston, Massachusetts, USA
# Omaha, Nebraska, USA
# Minneapolis, Minnesota, USA
# Windsor, Ontario, Canada
# Moist mid-latitude climate with mild winters.
# This is a temperate climate without dry season and a warm summer.  This climate is also known as the oceanic (marine) climate. Heavy precipitation occurs during the mild winters because of continuous presence of mid-latitude cyclones.
# Examples;
# Mexico City, Mexico
# Moist mid-latitude climate with cold winters.
# This is a cold climate without dry season and warm summer.
# Examples;
# Calgary, Alberta, Canada
# Winnipeg, Manitoba, Canada
# Ottawa, Ontario, Canada
# Toronto Islands, Ontario, Canada
# London, Ontario, Canada
# Kiev, Ukraine
# Moscow, Russia
# Saint Petersburg, Russia
# Stockholm, Sweden
# Oslo, Norway
# Lillehammer, Norway
# Portland, Maine, USA
# Montpelier, Vermont, USA
# Binghamton, New York, USA
# Moist mid-latitude climate with cold winters.
# This is a cold climate with dry winter and cold summer.
# Examples;
# Mohe County, Heliongjiang, China
# Yushu City, Qinghai, China
# Moist mid-latitude climate with cold winters.
# This is a cold climate with dry winter and cold summer.
# Examples;
# Mohe County, Heliongjiang, China
# Yushu City, Qinghai, China
ashrae_climate_zone_classification = Panel("""1A
2A
3A
5A
4A
6A
7
8""")
koppen_climate_zone_classification = Panel("""Af
Cfa
Cfa
Dfa
Cfb
Dfb
Dwc
Dwc""")
kuala_lumpur_1a = Panel("https://www.energyplus.net/weather-download/southwest_pacific_wmo_region_5/MYS//MYS_Kuala.Lumpur.486470_IWEC/all")
brisbane_2a = Panel("https://www.energyplus.net/weather-download/southwest_pacific_wmo_region_5/AUS//AUS_QLD.Brisbane.945780_IWEC/all")
athens_3a = Panel("https://www.energyplus.net/weather-download/europe_wmo_region_6/GRC//GRC_Athens.167160_IWEC/all")
boston_4a = Panel("https://www.energyplus.net/weather-download/north_and_central_america_wmo_region_4/USA/MA/USA_MA_Boston-Logan.Intl.AP.725090_TMY/all")
amsterdam_5a = Panel("https://www.energyplus.net/weather-download/europe_wmo_region_6/NLD//NLD_Amsterdam.062400_IWEC/all")
helsinki_6a = Panel("https://www.energyplus.net/weather-download/europe_wmo_region_6/FIN//FIN_Helsinki.029740_IWEC/all")
irkutsk_7 = Panel("https://www.energyplus.net/weather-download/asia_wmo_region_2/RUS//RUS_Irkutsk.307100_IWEC/all")
yellowknife_8 = Panel("https://www.energyplus.net/weather-download/north_and_central_america_wmo_region_4/CAN/NT/CAN_NT_Yellowknife.719360_CWEC/all")
item_4 = ListItem(
    List=[kuala_lumpur_1a, brisbane_2a, athens_3a, boston_4a, amsterdam_5a, helsinki_6a, irkutsk_7, yellowknife_8],
    Index=item_3,
    Wrap=True)
epw_stat = Ladybug_OpenEPWAndSTATWeatherFiles(weatherFileURL=item_4)  # -> epwFile, statFile; plug-in component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

# ----
toggle = BooleanToggle(False)
re_run_osm = Honeybee_ReRunOSM(osmFilePath=branch, epwFileAddress=epw_stat.epwFile, parallel=toggle, runIt=toggle)  # -> readMe, idfFileAddress, resultFileAddress, eioFileAddress, rddFileAddress; plug-in component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
