# Grasshopper definition 180516_EnergyAI_SimpleBoxStudy.gh (Grasshopper 0.9.76)
# plug-ins: Python Interpreter, ItemSelector

ladybug = Ladybug_Ladybug()  # -> Vviiiiiiiiiizzz; plug-in component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

# ---- group: Input Parameters
# Variable Parameters: ASHRAE Climate Zone
# Orientation
# WWR
# U Value
# SHGC
# Overhang Depth
# HVAC System Type
fixed_parameters = Panel("""Height
Program
Visible Transmittance""")
heat_recovery = Slider(0, range=0..2)
bldgprograms = Honeybee_bldgPrograms({"Office": 0, "Retail": 1, "MidriseApartment": 2, "PrimarySchool": 3, "SecondarySchool": 4, "SmallHotel": 5, "LargeHotel": 6, "Hospital": 7, "Outpatient": 8, "Warehouse": 9, "SuperMarket": 10, "FullServiceRestaurant": 11, "QuickServiceRestaurant": 12}, selected="Office")
ashrae_climate_zone = Slider(0, range=0..7)
u_value = Slider(0, range=0..1)
shgc = Slider(0, range=0..2)
overhang = Slider(0, range=0..2)
hvac_system_type = Slider(0, range=0..2)
height = Slider(3, range=0..10)
visible_transmittance = Slider(0.58, range=0..1)
orientation = Slider(1, range=0..4)
listzoneprograms = Honeybee_ListZonePrograms(bldgProgram=bldgprograms)  # -> OfficeZonePrograms; plug-in component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
list = Honeybee_ItemSelector(
    listzoneprograms,
    {"Office::BreakRoom", "Office::Storage", "Office::Vending", "Office::OpenOffice", "Office::ClosedOffice", "Office::Conference", "Office::PrintRoom", "Office::Restroom", "Office::Elec/MechRoom", "Office::IT_Room", "Office::Stair", "Office::Corridor", "Office::Lobby"}, selected="Office::ClosedOffice")

# ----
wwr = Slider(0, range=0..6)

# ---- group: Importing Weather Data for all Climate Zones
# Selected Locations: Kuala Lumpur - Malaysia
# Brisbane - Australia
# Athens - Greece
# Boston - USA
# Amsterdam - Netherlands
# Helsinki - Finland
# Irkutsk - Russia
# Yellowknife - Canada
# ASHRAE Climate Zone Description: Very Hot - Humid
# Hot - Humid
# Warm - Humid
# Cold - Humid
# Mixed - Humid
# Cold - Humid
# Very Cold
# Subarctic
# Koppen Climate Zone Description: Tropical Rainforest Climate
# This type of climate has every month of the year with an average temperature of 18 °C (64.4 °F) or higher, with precipitation all year long. Monthly temperature variations in this climate are less than 3 degrees Celsius. Because of intense surface heating and high humidity cumulus and cumulonimbus clouds form early in the afternoons almost every day. Daily highs are about 32 degrees Celsius while night time temperatures average 22 degrees Celsius.
# Examples;
# Singapore
# West Palm Beach, Florida, USA
# Hilo, Hawai, USA
# Moist mid-latitude climate with mild winters.
# This is a temperate climate without dry season and a hot summer.
# Examples;
# Sao Paulo, Brazil
# Brisbane, Australia
# Sydney, Australia
# Orlando, Florida, USA
# New Orleans, Florida, USA
# Washington D.C. USA
# Dallas, Texas, USA
# Srinagar, India
# Shanghai, China
# Nanjing, China
# Tokyo, Japan
# Osaka, Japan
# Milan, Italy
# Durban, South Africa
# Moist mid-latitude climate with mild winters.
# This is a temperate climate without dry season and a hot summer.
# Examples;
# Sao Paulo, Brazil
# Brisbane, Australia
# Sydney, Australia
# Orlando, Florida, USA
# New Orleans, Florida, USA
# Washington D.C. USA
# Dallas, Texas, USA
# Srinagar, India
# Shanghai, China
# Nanjing, China
# Tokyo, Japan
# Osaka, Japan
# Milan, Italy
# Durban, South Africa
# Moist mid-latitude climate with cold winters.
# This is a cold climate without dry season and hot summer.
# Examples;
# Chicago, Illinois, USA
# Columbus, Ohio, USA
# Boston, Massachusetts, USA
# Omaha, Nebraska, USA
# Minneapolis, Minnesota, USA
# Windsor, Ontario, Canada
# Moist mid-latitude climate with mild winters.
# This is a temperate climate without dry season and a warm summer.  This climate is also known as the oceanic (marine) climate. Heavy precipitation occurs during the mild winters because of continuous presence of mid-latitude cyclones.
# Examples;
# Mexico City, Mexico
# Moist mid-latitude climate with cold winters.
# This is a cold climate without dry season and warm summer.
# Examples;
# Calgary, Alberta, Canada
# Winnipeg, Manitoba, Canada
# Ottawa, Ontario, Canada
# Toronto Islands, Ontario, Canada
# London, Ontario, Canada
# Kiev, Ukraine
# Moscow, Russia
# Saint Petersburg, Russia
# Stockholm, Sweden
# Oslo, Norway
# Lillehammer, Norway
# Portland, Maine, USA
# Montpelier, Vermont, USA
# Binghamton, New York, USA
# Moist mid-latitude climate with cold winters.
# This is a cold climate with dry winter and cold summer.
# Examples;
# Mohe County, Heliongjiang, China
# Yushu City, Qinghai, China
# Moist mid-latitude climate with cold winters.
# This is a cold climate with dry winter and cold summer.
# Examples;
# Mohe County, Heliongjiang, China
# Yushu City, Qinghai, China
ashrae_climate_zone_classification = Panel("""1A
2A
3A
5A
4A
6A
7
8""")
koppen_climate_zone_classification = Panel("""Af
Cfa
Cfa
Dfa
Cfb
Dfb
Dwc
Dwc""")
brisbane_2a = Panel("https://www.energyplus.net/weather-download/southwest_pacific_wmo_region_5/AUS//AUS_QLD.Brisbane.945780_IWEC/all")
athens_3a = Panel("https://www.energyplus.net/weather-download/europe_wmo_region_6/GRC//GRC_Athens.167160_IWEC/all")
boston_4a = Panel("https://www.energyplus.net/weather-download/north_and_central_america_wmo_region_4/USA/MA/USA_MA_Boston-Logan.Intl.AP.725090_TMY/all")
amsterdam_5a = Panel("https://www.energyplus.net/weather-download/europe_wmo_region_6/NLD//NLD_Amsterdam.062400_IWEC/all")
helsinki_6a = Panel("https://www.energyplus.net/weather-download/europe_wmo_region_6/FIN//FIN_Helsinki.029740_IWEC/all")
irkutsk_7 = Panel("https://www.energyplus.net/weather-download/asia_wmo_region_2/RUS//RUS_Irkutsk.307100_IWEC/all")
kuala_lumpur_1a = Panel("https://www.energyplus.net/weather-download/southwest_pacific_wmo_region_5/MYS//MYS_Kuala.Lumpur.486470_IWEC/all")
yellowknife_8 = Panel("https://www.energyplus.net/weather-download/north_and_central_america_wmo_region_4/CAN/NT/CAN_NT_Yellowknife.719360_CWEC/all")
item = ListItem(
    List=[kuala_lumpur_1a, brisbane_2a, athens_3a, boston_4a, amsterdam_5a, helsinki_6a, irkutsk_7, yellowknife_8],
    Index=ashrae_climate_zone,
    Wrap=True)
epw_stat = Ladybug_OpenEPWAndSTATWeatherFiles(weatherFileURL=item)  # -> epwFile, statFile; plug-in component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
importstat = Ladybug_ImportStat(statFile=epw_stat.statFile)  # -> readMe, ashraeClimateZone, ashraeZoneDescription, koppenClimateZone, koppenZoneDescription, port, heatingDesignDay, coolingDesignDay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; plug-in component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

# ----
honeybee = Honeybee_Honeybee()  # -> Vviiiiiiiiiizzz; plug-in component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

fly = Ladybug_fly(
    inputSliders=[ashrae_climate_zone, orientation, wwr, u_value, shgc, overhang, hvac_system_type, heat_recovery],
    fly=Toggle(False))  # -> Vviiiiiiiiiizzz; plug-in component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

# ---- group: Geometry Preparation
number_slider = Slider(12, range=0..100)
rectangle = Rectangle(Plane=PlaneXY(0, 0, 0), XSize=number_slider, YSize=number_slider, Radius=0)  # -> Rectangle, Length
number_slider_2 = Slider(3, range=0..10)
boundary = BoundarySurfaces(Edges=rectangle.Rectangle)
orientation_2 = Panel("""West
South
Core
North
East""")
divide = DivideDomain²(Domain=boundary, UCount=number_slider_2, VCount=number_slider_2)
subsrf = Isotrim(Surface=boundary, Domain=divide)
panel = Panel("""1
3
4
5
7""")
Z = UnitZ(Factor=height)
item_2 = ListItem(List=panel, Index=orientation, Wrap=True)
extr = Extrude(Base=subsrf, Direction=Z)
item_3 = ListItem(List=extr, Index=item_2, Wrap=True)
cull_i = CullIndex(List=extr, Indices=item_2, Wrap=True)

# ----
item_4 = ListItem(List=orientation_2, Index=orientation, Wrap=True)

# ---- group: Creating HB Zones
toggle = BooleanToggle(True)
# Not sure if we want to separate the core
#  here and put it as different zone /
# conditioning.
panel_2 = Panel("SimulatedZone")
mass2zone = Honeybee_Masses2Zones(
    zoneMasses=flatten(item_3),
    zoneNames=panel_2,
    zonePrograms=list,
    isConditioned=Toggle(True),
    maxRoofAngle=30,
    createHBZones=toggle)  # -> readMe, HBZones; plug-in component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
mass2zone_2 = Honeybee_Masses2Zones(zoneMasses=flatten(cull_i), zonePrograms=list, isConditioned=Toggle(True), maxRoofAngle=30, createHBZones=toggle)  # -> readMe, HBZones; plug-in component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

# ---- group: EP Window Construction
shgc_2 = Panel("""0.2
0.3
0.4""")
u_value_2 = Panel("""1.048
0.575""")
u_value_3 = Panel("""DP
TP""")
item_5 = ListItem(List=u_value_3, Index=u_value, Wrap=True)
item_6 = ListItem(List=u_value_2, Index=u_value, Wrap=True)
item_7 = ListItem(List=shgc_2, Index=shgc, Wrap=True)
concat = Concatenate(FragmentA=item_5, FragmentB="_", FragmentC=item_7)
epwindowmat = Honeybee_EnergyPlusWindowMaterial(name=concat, U_Value=item_6, SHGC=item_7, VT=visible_transmittance)  # -> EPMaterial; plug-in component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
epconstruction = Honeybee_EnergyPlusConstruction(name=concat, layer_1=epwindowmat)  # -> EPConstruction; plug-in component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

# ---- group: Solve Adjacencies
solveadjc = Honeybee_SolveAdjacencies(
    HBZones=flatten([mass2zone.HBZones, mass2zone_2.HBZones]),
    altBC="adiabatic",
    removeCurrentAdjc=False,
    findAdjc=Toggle(True))  # -> readMe, HBZonesWADJ; plug-in component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

# ---- group: Create Glazing
getsethbobjname = Honeybee_GetOrSetHBObjectName(HBObjects=solveadjc.HBZonesWADJ)  # -> HBObjects, names; plug-in component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
concat_2 = Concatenate(FragmentA=panel_2, FragmentB="_0")
wwr_2 = Panel("""0.2
0.3
0.4
0.5
0.6
0.7
0.8""")
item_8 = ListItem(List=wwr_2, Index=wwr, Wrap=True)
eval = Evaluate(F="if(x=y,1,0)", x=getsethbobjname.names, y=concat_2)
cull = CullPattern(List=solveadjc.HBZonesWADJ, CullPattern=eval)
glazingcreator = Honeybee_GlazingBasedOnRatio(HBObjects=cull, glzRatio=item_8, breakUpDist="4", EPConstructions=epconstruction, runIt=Toggle(True))  # -> readMe, HBObjWGLZ; plug-in component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
cull_2 = CullPattern(List=solveadjc.HBZonesWADJ, CullPattern=invert(eval))

# ----
toggle_2 = BooleanToggle(True)
makeadiabaticbytype = Honeybee_MakeAdiabaticByType(HBZones=glazingcreator.HBObjWGLZ, roofs=toggle_2, groundFloors=toggle_2)  # -> HBZones; plug-in component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

# ---- group: Assign Constructions Based on ASHRAE Climate Zone
callfromepconstrlibrary = Honeybee_CallFromEPConstructionLibrary()  # -> ThermMaterials, EPMaterials, EPWindowMaterials, EPConstructions; plug-in component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
searchepconstruction = Honeybee_SearchEPConstruction(
    EPConstrList=callfromepconstrlibrary.EPConstructions,
    standard="2",
    climateZone=importstat.ashraeClimateZone,
    surfaceType="0",
    keywords="steelframe")  # -> EPSelectedConstr; plug-in component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
item_9 = ListItem(List=searchepconstruction, Index=0, Wrap=True)
setepzonecnstr = Honeybee_SetEPZoneConstruction(HBZones=flatten(makeadiabaticbytype), wallEPConstruction=item_9)  # -> simplify(modifiedHBZones); plug-in component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

# ---- group: Create Overhang
overhang_depth = Panel("""0
0.5
1""")
item_10 = ListItem(List=overhang_depth, Index=overhang, Wrap=True)
epwindowshades = Honeybee_EnergyPlusWindowShadeGenerator(HBObjects=flatten(makeadiabaticbytype), depth=item_10, numOfShds="1", runIt=Toggle(True))  # -> readMe, port, HBObjWShades, port_2, windowBreps, shadeBreps, port_3, shadeMatName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; plug-in component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
hb_epcontextsrf = HoneybeeEPContextSurfaces(shdSurfaces=flatten(epwindowshades.shadeBreps))  # -> HBContext; inputs shdSurfaces: list of Brep, justBoundingBox: Boolean
# ---------- hb_epcontextsrf: Python ----------
"""
prepare shading/context geometries

    Args:
        northVectorOrRotation: A vector that shows North or a number that shows
                               the rotation of the North from the Y axis
        bldgMasses: List of closed Breps as thermal zones.
    Returns:
        report: ...
        thermalZones: Thermal zone's geometries for visualiza
"""

ghenv.Component.Name = 'Honeybee EP context Surfaces'
ghenv.Component.NickName = 'HB_EPContextSrf'
ghenv.Component.Message = 'VER 0.0.62\nJUL_28_2017'
ghenv.Component.IconDisplayMode = ghenv.Component.IconDisplayMode.application
ghenv.Component.Category = "Honeybee"
ghenv.Component.SubCategory = "10 | Energy | Energy"
#compatibleHBVersion = VER 0.0.57\nNOV_04_2016
#compatibleLBVersion = VER 0.0.59\nFEB_01_2015
ghenv.Component.AdditionalHelpFromDocStrings = "2"

import rhinoscriptsyntax as rs
import Rhino as rc
import scriptcontext as sc
import os
import System
import Grasshopper.Kernel as gh
import uuid

tolerance = sc.doc.ModelAbsoluteTolerance
import math


def main(shdSurfaces, EPTransSchedule, meshingSettings, justBoundingBox):
    
    # import the classes
    if sc.sticky.has_key('honeybee_release'):

        try:
            if not sc.sticky['honeybee_release'].isCompatible(ghenv.Component): return -1
            if sc.sticky['honeybee_release'].isInputMissing(ghenv.Component): return -1
        except:
            warning = "You need a newer version of Honeybee to use this compoent." + \
            " Use updateHoneybee component to update userObjects.\n" + \
            "If you have already updated userObjects drag Honeybee_Honeybee component " + \
            "into canvas and try again."
            w = gh.GH_RuntimeMessageLevel.Warning
            ghenv.Component.AddRuntimeMessage(w, warning)
            return -1
        
        # don't customize this part
        hb_EPSrf = sc.sticky["honeybee_EPSurface"]
        hb_EPSHDSurface = sc.sticky["honeybee_EPShdSurface"]
        hb_RADMaterialAUX = sc.sticky["honeybee_RADMaterialAUX"]
        hb_EPObjectsAux = sc.sticky["honeybee_EPObjectsAUX"]()
        HBScheduleList = sc.sticky["honeybee_ScheduleLib"].keys()

        ########################################################################
        #----------------------------------------------------------------------#
        shdBreps = []
        # create bounding box of shading geometries
        if justBoundingBox:
            for brep in shdSurfaces:
                if brep.Faces.Count>1 or not brep.Faces[0].IsPlanar(sc.doc.ModelAbsoluteTolerance):
                    shdBreps.append(brep.GetBoundingBox(True).ToBrep())
                else:
                    shdBreps.append(brep)
        else:
            shdBreps = shdSurfaces
        
        shadingClasses = []
        shadingMeshPreview = []
        
        if meshingSettings == None:
            mp = rc.Geometry.MeshingParameters.Minimal
            mp.SimplePlanes = True
        else:
            mp = meshingSettings
        
        def getRadMaterialName(radMaterial):
            nameStr = radMaterial.split(" ")[2]
            name =  nameStr.split("\n")[0]
            return name
        
        for brepCount, brep in enumerate(shdBreps):
            if brep != None:
                isPlanar = True
                # check planarity
                for face in brep.Faces:
                    if not face.IsPlanar(tolerance):
                        isPlanar = False
                        break
                
                shadingBreps = []
                if not isPlanar:
                    meshArray = rc.Geometry.Mesh.CreateFromBrep(brep, mp)
                    for mesh in meshArray:
                        for meshFace in range(mesh.Faces.Count):
                            vertices = list(mesh.Faces.GetFaceVertices(meshFace))[1:]
                            vertices = vertices + [sc.doc.ModelAbsoluteTolerance]
                            # create the brep from mesh
                            shdBrep = rc.Geometry.Brep.CreateFromCornerPoints(*vertices)
                            shadingBreps.append(shdBrep)
                else:
                    for face in brep.Faces:
                        shadingBreps.append(face.DuplicateFace(False))
                
                for faceCount, shdBrep in enumerate(shadingBreps):
                        thisShading = hb_EPSHDSurface(shdBrep, 1000*brepCount + faceCount, 'shdSrf_' + `brepCount` + '_' + `faceCount` + "_" + str(uuid.uuid4()))
                        
                        # add transmittance schedule if any
                        if EPTransSchedule!=None:
                            schedule= EPTransSchedule.upper()
                            if schedule!=None and not schedule.lower().endswith(".csv") and schedule not in HBScheduleList:
                                msg = "Cannot find " + schedule + " in Honeybee schedule library."
                                print msg
                                ghenv.Component.AddRuntimeMessage(gh.GH_RuntimeMessageLevel.Warning, msg)
                                return -1
                            elif schedule!=None and schedule.lower().endswith(".csv"):
                                # check if csv file is existed
                                if not os.path.isfile(schedule):
                                    msg = "Cannot find the shchedule file: " + schedule
                                    print msg
                                    ghenv.Component.AddRuntimeMessage(gh.GH_RuntimeMessageLevel.Warning, msg)
                                    return -1
                            
                            thisShading.TransmittanceSCH = schedule
                        
                        # add the Rad Material if any
                        if RADMaterial!=None:
                            # if it is just the name of the material make sure it is already defined
                            if len(RADMaterial.split(" ")) == 1:
                                # if the material is not in the library add it to the library
                                if not hb_RADMaterialAUX.isMatrialExistInLibrary(RADMaterial):
                                    warningMsg = "Can't find " + RADMaterial + " in RAD Material Library.\n" + \
                                                "Add the material to the library and try again."
                                    ghenv.Component.AddRuntimeMessage(gh.GH_RuntimeMessageLevel.Warning, warningMsg)
                                    return
                                
                                try:
                                    thisShading.setRADMaterial(RADMaterial)
                                except Exception, e:
                                    print e
                                    warningMsg = "You are using an old version of Honeybee_Honeybee! Update your files and try again."
                                    print warningMsg
                                    ghenv.Component.AddRuntimeMessage(gh.GH_RuntimeMessageLevel.Warning, warningMsg)
                                    return
                                
                                addedToLib = True
                            else:
                                
                                # try to add the material to the library
                                addedToLib, thisShading.RadMaterial = hb_RADMaterialAUX.analyseRadMaterials(RADMaterial, True)
                                
                            if addedToLib==False:
                                warningMsg = "Failed to add " + RADMaterial + " to the Library."
                                ghenv.Component.AddRuntimeMessage(gh.GH_RuntimeMessageLevel.Warning, warningMsg)
                                return
                        
                        # add shading to the list
                        shadingClasses.append(thisShading)
                
        # add to the hive
        hb_hive = sc.sticky["honeybee_Hive"]()
        HBContext  = hb_hive.addToHoneybeeHive(shadingClasses, ghenv.Component)
        return HBContext
        ################################################################################################
    else:
        print "You should first let Honeybee to fly..."
        w = gh.GH_RuntimeMessageLevel.Warning
        ghenv.Component.AddRuntimeMessage(w, "You should first let Honeybee to fly...")
        return -1
        

if _shdSurfaces and _shdSurfaces[0]!=None:
    # add cleaning function
    result= main(_shdSurfaces, EPTransSchedule_, meshingSettings_, justBoundingBox_)
    
    if result != -1: HBContext = result
# ---------- end hb_epcontextsrf ----------

# ---- group: Visualize the Scene
decomposebytype = Honeybee_DecomposeBasedOnType(HBZone=glazingcreator.HBObjWGLZ)  # -> walls, interiorWalls, airWalls, windows, interiorWindows, skylights, roofs, ceilings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; plug-in component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
wires = BrepWireframe(Brep=[glazingcreator.HBObjWGLZ, cull_2], Density=-1)
preview = CustomPreview(Geometry=decomposebytype.windows, Shader=ColourSwatch(SwatchColor=RGBA(153, 241, 255, 119)))

# ---- group: HVAC System Settings
# HVAC System Type: VAV w/Reheat
# FCU + DOAS
# VRF + DOAS
effectiveness = Panel("""0.5
0.5
0.75""")
heat_recovery_2 = Panel("""None
Sensible
Enthalpy Wheel""")
larger = LargerThan(FirstNumber=heat_recovery, SecondNumber="0")  # -> LargerThan, OrEqualTo
item_11 = ListItem(List=effectiveness, Index=heat_recovery, Wrap=True)
gate = StreamGate(Stream=item_11, Gate=larger.LargerThan)  # -> Target0, Target1
heatingdetails = Honeybee_HVACHeatingDetails(heatingEffOrCOP="0.9")  # -> heatingDetails; plug-in component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
coolingdetails = Honeybee_HVACCoolingDetails(coolingCOP="4.5", heatRejectionType="0")  # -> coolingDetails; plug-in component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
airdetails = Honeybee_HVACAirDetails(heatRecovery=heat_recovery, recoveryEffectiveness=gate.Target1)  # -> airDetails; plug-in component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
panel_3 = Panel("""7
11
16""")
item_12 = ListItem(List=panel_3, Index=hvac_system_type, Wrap=True)
hvacsystem = Honeybee_AssignHVACSystem(
    HBZones=flatten(setepzonecnstr),
    HVACSystems=item_12,
    airDetails=airdetails,
    heatingDetails=heatingdetails,
    coolingDetails=coolingdetails)  # -> readMe, HBZones; plug-in component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

# ----
toggle_3 = BooleanToggle(True)
epoutput = Honeybee_GenerateEPOutput(zoneEnergyUse=toggle_3, zoneGainsAndLosses="False", zoneComfortMetrics=toggle_3, surfaceTempAnalysis="False")  # -> report, flatten(simulationOutputs); plug-in component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

# ---- group: Filename
multiplication = Multiplication(A=item_8, B="100")
addition = Addition(A="1", B=ashrae_climate_zone)
int = Integer(multiplication)
int_2 = Integer(heat_recovery)
concat_3 = Concatenate(
    FragmentA="CZ_",
    FragmentB=addition,
    FragmentP="_",
    FragmentC="OR_",
    FragmentD=item_4,
    FragmentF="_",
    FragmentE="WWR_",
    FragmentQ=int,
    FragmentS="_",
    FragmentG="UV_",
    FragmentH=item_5,
    FragmentR="_",
    FragmentI="SHGC_",
    FragmentJ=item_7,
    FragmentT="_",
    FragmentK="OV_",
    FragmentL=item_10,
    FragmentU="_",
    FragmentM="HVAC_",
    FragmentN=item_12,
    FragmentV="_",
    FragmentO="HR_",
    FragmentW=int_2)

# ----
setepzonethresholds = Honeybee_SetEnergyPlusZoneThresholds(HBZones=hvacsystem.HBZones, daylightIllumSetPt="300", daylightCntrlFract="1")  # -> readMe, HBZones; plug-in component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

# ---- group: Generate IDF
exporttoopenstudio = Honeybee_ExportToOpenStudio(
    epwWeatherFile=epw_stat.epwFile,
    HBZones=flatten(setepzonethresholds.HBZones),
    HBContext=flatten(hb_epcontextsrf),
    simulationOutputs=flatten(epoutput.simulationOutputs),
    writeOSM=Toggle(False),
    fileName=concat_3,
    workingDir="D:\Projects\Research\SimAud_ParametricAI\IDFs")  # -> readMe, osmFileAddress, idfFileAddress, resultFileAddress, eioFileAddress, rddFileAddress, htmlReport, studyFolder, model; plug-in component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
